# Grasshopper definition Fields Tests.gh (Grasshopper 0.9.76)
# plug-ins: Groundhog

crv = Curve([<curve referenced from the Rhino model> x3])
# Could I construct it using drape? Isn't that kinda what I'm doing anyway?
crv_2 = Curve([<curve referenced from the Rhino model> x3])
crv_3 = Curve([<curve referenced from the Rhino model> x3])
crv_4 = Curve(<curve referenced from the Rhino model>)
crv_5 = Curve(<curve referenced from the Rhino model>)
crv_6 = Curve([<curve referenced from the Rhino model> x4])
crv_7 = Curve(<curve referenced from the Rhino model>)
crv_8 = Curve([crv, crv_3, crv_2])
c_script = CSharpScript(B=crv_4, F=Slider(27, range=0..100), A=crv_8)  # -> out, out1, out2; inputs B: Curve, F: Int32, A: list of Curve
# ---------- c_script: C# ----------
    // Fidelity should default to like 10?
    int FIDELITY = F;

    // Validate input curves are planar
    //if (!B.IsPlanar())
    //{
    //AddRuntimeMessage(GH_RuntimeMessageLevel.Error, "Boundary curve is not planar");
    //}

    //for (int i = 0; i < A.Length; i = i + 1)
    //{
    //  if (!A[i].IsPlanar())
    //  {
    //    //AddRuntimeMessage(GH_RuntimeMessageLevel.Error, "Boundary curve #{0}, is not planar", i);
    //  }
    //}

    Curve BOUNDARY = B;
    List<Curve> ALL_DATA_REGIONS = A;

    // Construct the bounding box; identify its extents
    BoundingBox boundaryBox = BOUNDARY.GetBoundingBox(false); // False = uses estimate method
    Point3d[] corners = boundaryBox.GetCorners();
    double xLength = corners[1][0] - corners[0][0];
    double yLength = corners[2][1] - corners[0][1];
    double BOUNDARYZ = corners[0][2];
    double maxLength = Math.Sqrt(Math.Pow(xLength, 2) + Math.Pow(yLength, 2));

    // Use these to determine the number of grid points
    double gridSpacing = Math.Max(xLength, yLength) / (double)FIDELITY;
    int xGridExtents = (int)Math.Floor(xLength / gridSpacing);
    int yGridExtents = (int)Math.Floor(yLength / gridSpacing);

    // Start top left (as measured from center point)
    Point3d middlePt = new Point3d(
      corners[0][0] + xLength / 2, 
      corners[0][1] + yLength / 2, 
      BOUNDARYZ
     );
    Point3d startPt = new Point3d( // Bottom Left
      middlePt[0] - gridSpacing * (xGridExtents / 2),
      middlePt[1] - gridSpacing * (yGridExtents / 2),
      BOUNDARYZ);
    
    double xSpacingBump;
    if (xGridExtents % 2 == 0) {
      xSpacingBump = gridSpacing / 2;
    } else {      
      xSpacingBump = 0;
    }
    double ySpacingBump;
    if (yGridExtents % 2 == 0) {
      ySpacingBump = gridSpacing / 2;
    } else {      
      ySpacingBump = 0;
    }
    
    Print("{0}", xGridExtents);
    Print("{0}", yGridExtents);
    
    // Make grid points
    List<GridPt> gridPts = new List<GridPt>();
    for (int x = 0; x < xGridExtents; x = x + 1) {
      for (int y = 0; y < yGridExtents; y = y + 1) {
        Print("{0}", startPt[1] + gridSpacing * y);
        gridPts.Add(new GridPt{
          location = new Point3d(
            startPt[0] + gridSpacing * x + xSpacingBump,
            startPt[1] + gridSpacing * y + ySpacingBump,
            BOUNDARYZ
          )            
        });
      }
    }
    
    List<Point3d> outputs = new List<Point3d>();
    for (int i = 0; i < gridPts.Count; i = i + 1) {
      outputs.Add(gridPts[i].location);
    }
    out1 = outputs;
    out2 = middlePt;
# ---------- c_script: C# additional code ----------
  class GridPt
  {
    public int overlaps = 0; // Records number of times it overlaps with a data region
    public Point3d location { get; set; }
  }
# ---------- end c_script ----------
field = FieldMapper(Bounds=crv_7, Divisions=Slider(100, range=0..100), Areas=crv_8)
field_2 = FieldMapper(Bounds=crv_5, Areas=crv_6)
pt = Point(c_script.out2)
pt_2 = Point(c_script.out1)
panel = Panel(c_script.out)
# Field Gen (Makes Surface from Geo)
num = Number()
# Field Gen (Makes Surface from Geo)
num_2 = Number()
boundary = BoundarySurfaces(Edges=crv_5)
sdivide = DivideSurface(Surface=boundary, UCount=10, VCount=10)  # -> Points, Normals, Parameters
lng = ListLength(List=flatten(sdivide.Points))
# See blending http://formularch.blogspot.com.au/2012/03/gh-surface-blend.html?m=1
random = Random(Range=Domain(0, 10), Number=lng, Seed=2)
panel_2 = Panel("Field Tween(Circles)")
panel_3 = Panel("Fild Vis (Circles)")
num_3 = Number([num_2, num])
Z = UnitZ(Factor=random)
num_4 = Number(num_2)
move = Move(Geometry=flatten(sdivide.Points), Motion=Z)  # -> Geometry, Transform
panel_4 = Panel("Field Vis (Circles)")
srfgrid = SurfaceFromPoints(Points=move.Geometry, UCount=Slider(11, range=0..100), Interpolate=False)
num_5 = Number(num_3)
# Field Vis (Heat Map)
num_6 = Number(num_3)
