# Grasshopper definition Groundhog - Flows Examples.ghx (Grasshopper 1.0.7)
# plug-ins: Groundhog

flow_step_size = Slider(25, range=0..100)
flow_step_limit = Slider(75, range=0..100)
proximity_threshold = Slider(97, range=0..200)
# Example 2 (Upper-Right)
random_points_count = Slider(142, range=0..1000)
multithread = BooleanToggle(False)

# ----
# Example 1 (Lower-Left)
u_count = Slider(20, range=0..50)
v_count = Slider(20, range=0..50)

# ---- group: Base Surface
# Groundhog Example File
# Definition prepared for Groundhog v0.11.1b and depends on components from that plugin. It is available for download at http://groundhog.la/
# 
# Contact groundhog@philipbelesky.com for support or feedback.
# 
# This is an example file related to the plugin's documentation.
surface = Surface(<surface referenced from the Rhino model>)

# ---- group: Base Mesh
mesh = Mesh(<mesh referenced from the Rhino model>)

# ---- group: Create point grid for path starts
divide_surface = DivideSurface(Surface=surface, UCount=u_count, VCount=v_count)  # -> flatten(Points), Normals, Parameters

# ---- group: Distribute points randomly on mesh for path starts
cluster = Cluster(C=mesh, N=random_points_count)

# ---- group: Calculate the flow paths (for mesh)
flow_projection_mesh = FlowSimulationMesh(Mesh=mesh, Points=cluster, Fidelity=flow_step_size, Steps=flow_step_limit, Thread=multithread)  # -> FlowPoints, FlowPaths

# ---- group: Calculate the flow paths (for surface)
flow_projection_surface = FlowProjectionSurface(Surface=surface, Points=divide_surface.Points, Fidelity=0, Steps=0, Thread=False)  # -> FlowPoints, FlowPaths

# ---- group: Calculate catchment bounds
flow_catchments = FlowCatchments(FlowPaths=flow_projection_surface.FlowPaths)  # -> Catchments, FlowPaths, ColorCodes, Volumes

flow_catchments_2 = FlowCatchments(FlowPaths=flow_projection_mesh.FlowPaths, ProximityThreshold=proximity_threshold)  # -> Catchments, FlowPaths, ColorCodes, Volumes

# ---- group: Color code catchment boundaries
colours = Data(flow_catchments.ColorCodes)
catchment_alpha = Slider(0.1, range=0..1)
catchments = Data(flow_catchments.Catchments)
split_ahsl = SplitAHSL(Colour=colours)  # -> Alpha, Hue, Saturation, Luminance
colour_hsl = ColourHSL(Alpha=catchment_alpha, Hue=split_ahsl.Hue, Saturation=split_ahsl.Saturation, Luminance=split_ahsl.Luminance)
boundary_surfaces = BoundarySurfaces(Edges=catchments)
custom_preview = CustomPreview(Geometry=boundary_surfaces, Shader=colour_hsl)

# ---- group: Color flow paths by length from source
flow_paths = Data(flow_catchments.FlowPaths)
minimum_luminance = Slider(0, range=0..1)
luminance_step = Slider(-0.02, range=-1..0.1)
explode = Explode(Curve=flow_paths, Recursive=True)  # -> Segments, Vertices
list_length = ListLength(List=explode.Segments)
series = Series(Start=1, Step=luminance_step, Count=list_length)
maximum = Maximum(A=series, B=minimum_luminance)
colour_hsl_2 = ColourHSL(Alpha=1, Hue=0.5, Saturation=1, Luminance=maximum)
custom_preview_2 = CustomPreview(Geometry=explode.Segments, Shader=colour_hsl_2)

# ---- group: Label each group of end points by the volume of water collected
total_flow_volume = Slider(1000, range=100..1000)
z_height = Slider(1000, range=100..1000)
flow_paths_2 = Data(flow_catchments_2.FlowPaths)
proximity_threshold_2 = Number(proximity_threshold)
colours_2 = Data(flow_catchments_2.ColorCodes)
flow_volumes = Number(flow_catchments_2.Volumes)
average_end_point = AverageEndPoint(flow_paths=flow_paths_2, z_height=z_height)
multiplication = Multiplication(A=flow_volumes, B=total_flow_volume)
circle_cnr = CircleCNR(Center=average_end_point, Normal=Vector(0, 0, 1), Radius=proximity_threshold_2)
division = Division(A=proximity_threshold_2, B=10)
concatenate = Concatenate(FragmentA=multiplication, FragmentB=" litres")
dash_pattern = DashPattern(Curve=circle_cnr, Pattern=division)  # -> Dashes, Gaps
label_szie = Slider(40, range=0..100)
label_color = ColourSwatch(SwatchColor=RGB(255, 255, 255))
text_tag_3d = TextTag3D(Location=average_end_point, Text=concatenate, Size=label_szie, Colour=label_color, Justification=7)
custom_preview_3 = CustomPreview(Geometry=average_end_point, Material=colours_2)
custom_preview_4 = CustomPreview(Geometry=dash_pattern.Dashes, Material=label_color)

# ---- group: Create and color a naïve flooding extents from end points
flow_paths_3 = Data(flow_projection_mesh.FlowPaths)
pooling_radius = Slider(481, range=0..3000)
sampling_accuracy = Slider(10, range=0..1000)
end_points = EndPoints(Curve=flow_paths_3)  # -> Start, End
deconstruct = Deconstruct(Point=end_points.End)  # -> XComponent, YComponent, ZComponent
construct_point = ConstructPoint(XCoordinate=deconstruct.XComponent, YCoordinate=deconstruct.YComponent, ZCoordinate=0)
list_length_2 = ListLength(List=construct_point)
repeat_data = RepeatData(Data=pooling_radius, Length=list_length_2)
metaball_t_custom = MetaBallTCustom(Points=construct_point, Charge=repeat_data, Plane=PlaneXY(0, 0, 0), Threshold=0.5, Accuracy=sampling_accuracy)
simplify_curve = SimplifyCurve(Curve=metaball_t_custom, Tolerance=5, AngleTolerance=1)  # -> Curve, Simplified
pooling_color = ColourSwatch(SwatchColor=RGBA(128, 132, 180, 153))
boundary_surfaces_2 = BoundarySurfaces(Edges=simplify_curve.Curve)
custom_preview_5 = CustomPreview(Geometry=boundary_surfaces_2, Shader=pooling_color)

# ---- group: Color code flow paths by catchment
custom_preview_6 = CustomPreview(Geometry=flow_catchments_2.FlowPaths, Shader=flow_catchments_2.ColorCodes)

# ==== cluster Cluster
N = ClusterInput()
C = ClusterInput()
bbox = BoundingBox(Content=C, Plane=PlaneXY(0, 0, 0))  # -> Box, Box_2
debrep = DeconstructBrep(Brep=bbox.Box)  # -> Faces, Edges, Vertices
item = ListItem(List=debrep.Faces, Index=Slider(5, range=0..10), Wrap=True)
pop2d = Populate2D(Region=item, Count=N, Seed=1)
volume = Volume(Geometry=bbox.Box)  # -> Volume, Centroid
area = Area(Geometry=item)  # -> Area, Centroid
vector_2pt = Vector2Pt(PointA=area.Centroid, PointB=volume.Centroid, Unitize=False)  # -> Vector, Length
deconstruct_vector = DeconstructVector(Vector=vector_2pt.Vector)  # -> XComponent, YComponent, ZComponent
unit_z = UnitZ(Factor=deconstruct_vector.ZComponent)
project = ProjectPoint(Point=pop2d, Direction=unit_z, Geometry=C)  # -> Point, Index
P = ClusterOutput(project.Point)

# ==== cluster AverageEndPoint
z_height = ClusterInput()
flow_paths = ClusterInput()
z_height_2 = Number(z_height)
flow_paths_2 = Data(flow_paths)
end_points = EndPoints(Curve=flow_paths_2)  # -> Start, End
deconstruct = Deconstruct(Point=end_points.End)  # -> XComponent, YComponent, ZComponent
list_length = ListLength(List=end_points.End)
mass_addition = MassAddition(Input=deconstruct.XComponent)  # -> Result, PartialResults
mass_addition_2 = MassAddition(Input=deconstruct.YComponent)  # -> Result, PartialResults
division = Division(A=mass_addition.Result, B=list_length)
division_2 = Division(A=mass_addition_2.Result, B=list_length)
construct_point = ConstructPoint(XCoordinate=division, YCoordinate=division_2, ZCoordinate=z_height_2)
average_point = Point(construct_point)
average_point_2 = ClusterOutput(average_point)
