# Grasshopper definition Groundhog - Terrain Examples.ghx (Grasshopper 1.0.7)
# plug-ins: Groundhog

# ---- group: Assume North = y axis (this is the default if not set)
unit_y = UnitY(Factor="1")

# ----
aspect_angle = Vector(unit_y)
base_terrain_mesh = Mesh(<mesh referenced from the Rhino model>)

base_terrain_surface = Surface(<surface referenced from the Rhino model>)
base_terrain_surface_2 = Surface(<surface referenced from the Rhino model>)
# Groundhog Example File
# Definition prepared for Groundhog v0.13.0 and depends on components from that plugin. It is available for download at http://groundhog.philipbelesky.com/
# 
# Contact groundhog@philipbelesky.com for support or feedback.
# 
# This is an example .3dm file related to the plugin's documentation.
base_terrain_mesh_2 = Mesh(<mesh referenced from the Rhino model>)
base_terrain_mesh_3 = Mesh(<mesh referenced from the Rhino model>)

# ---- group: Calculate aspect from surface
surface_aspect = SurfaceAspect(Surface=base_terrain_surface_2, Aspect=Vector(0, 1, 0))  # -> MeshFaces, FaceCenters, FaceAspects

# ---- group: Calculate aspect from mesh
mesh_aspect = MeshAspect(Mesh=base_terrain_mesh, Aspect=aspect_angle)  # -> MeshFaces, FaceCenters, FaceAspectAngles

# ---- group: Calculate grade from surface
surface_slope = SurfaceSlope(Surface=base_terrain_surface)  # -> MeshFaces, FaceCenters, FaceVectors, FaceSlopes, FaceSlopes_2, FaceSlopes_3

# ---- group: Calculate aspect and slope from mesh
mesh_aspect_2 = MeshAspect(Mesh=base_terrain_mesh_3, Aspect=Vector(0, 1, 0))  # -> MeshFaces, FaceCenters, FaceAspectAngles
mesh_slope = MeshSlope(Mesh=base_terrain_mesh_3)  # -> MeshFaces, FaceCenters, FaceVectors, FaceSlopes, FaceSlopes_2, FaceSlopes_3

# ---- group: Calculate grade from mesh
mesh_slope_2 = MeshSlope(Mesh=base_terrain_mesh_2)  # -> MeshFaces, FaceCenters, FaceSlopeVectors, FaceSlopeAngles, FaceSlopes, FaceSlopes_2

# ---- group: Convert 0-360 range into 0-180
face_angles = Data(mesh_aspect_2.FaceAspectAngles)
subtraction = Subtraction(A=face_angles, B="180")
absolute = Absolute(Value=subtraction)

# ---- group: Convert Aspect to Hue Range
hue_start = Slider(0.3, range=0..1)
hue_end = Slider(0, range=0..1)
construct_domain = ConstructDomain(DomainStart=hue_start, DomainEnd=hue_end)
remap_numbers = RemapNumbers(Value=absolute, Source="180", Target=construct_domain)  # -> Mapped, Clipped

# ----
max_slope_cutoff = Slider(90, range=0..100)

# ---- group: Convert Slope to Saturation Range
sat_start = Slider(0, range=0..1)
sat_end = Slider(1, range=0..1)
slope = Data(mesh_slope.FaceSlopes_2)
construct_domain_2 = ConstructDomain(DomainStart=sat_start, DomainEnd=sat_end)
remap_numbers_2 = RemapNumbers(Value=slope, Source=max_slope_cutoff, Target=construct_domain_2)  # -> Mapped, Clipped

# ---- group: Convert Slope to Luminance Range
lum_start = Slider(0, range=0..1)
lum_end = Slider(0.5, range=0..1)
slope_2 = Data(mesh_slope.FaceSlopes_2)
construct_domain_3 = ConstructDomain(DomainStart=lum_start, DomainEnd=lum_end)
remap_numbers_3 = RemapNumbers(Value=slope_2, Source=max_slope_cutoff, Target=construct_domain_3)  # -> Mapped, Clipped

# ---- group: Visualise grade on mesh faces
max_slope = Slider(70, range=0..100)
mesh_faces = Mesh(base_terrain_mesh_2)
face_angles_2 = Data(mesh_slope_2.FaceSlopeAngles)
gradient = Gradient(LowerLimit=0, UpperLimit=max_slope, Parameter=face_angles_2, stops=[0: RGB(255, 255, 255), 1: RGB(0, 0, 0)])
mesh_color_by_face = MeshColorByFace(Mesh=base_terrain_mesh_2, Colors=gradient)

# ---- group: Visualise grade direction
vector_length = Slider(0.608, range=0..2)
vector_color = ColourSwatch(SwatchColor=RGB(255, 255, 255))
face_centers = Point(surface_slope.FaceCenters)
face_vectors = Vector(surface_slope.FaceVectors)
multiplication = Multiplication(A=face_vectors, B=vector_length)
angles_vectors = VectorDisplayEx(Point=face_centers, Vector=multiplication, Colour=vector_color, Width=2)

# ---- group: Label aspects within specified range
cutoff_b = Slider(120, range=0..360)
cutoff_a = Slider(180, range=0..360)
text_size = Slider(500, range=0..1000)
text_color = ColourSwatch(SwatchColor=RGB(0, 0, 0))
face_angles_3 = Data(mesh_aspect.FaceAspectAngles)
face_centers_2 = Point(mesh_aspect.FaceCenters)
construct_domain_4 = ConstructDomain(DomainStart=cutoff_b, DomainEnd=cutoff_a)
includes = Includes(Value=face_angles_3, Domain=construct_domain_4)  # -> Includes, Deviation
cull_pattern = CullPattern(List=face_centers_2, CullPattern=includes.Includes)
cull_pattern_2 = CullPattern(List=face_angles_3, CullPattern=includes.Includes)
angles_labels = TextTag3D(Location=cull_pattern, Text=cull_pattern_2, Size=text_size, Colour=text_color, Justification=5)

# ----
face_centers_3 = Point(surface_aspect.FaceCenters)

# ---- group: Combine measures of slope and aspect to 'hide' aspect measures on very flat surfaces
colour_hsl = ColourHSL(Alpha=1, Hue=remap_numbers.Clipped, Saturation=remap_numbers_2.Clipped, Luminance=remap_numbers_3.Clipped)
mesh_faces_2 = Mesh(base_terrain_mesh_3)
mesh_color_by_face_2 = MeshColorByFace(Mesh=mesh_faces_2, Colors=colour_hsl)

# ---- group: Visualise aspect as solid gradient
mesh_faces_3 = Mesh(base_terrain_surface_2)
max_aspect = Slider(360, range=0..1000)
face_angles_4 = Data(surface_aspect.FaceAspects)
blur_iterations = Slider(0.6, range=0.2..2)
gradient_2 = Gradient(
    LowerLimit=0,
    UpperLimit=max_aspect,
    Parameter=face_angles_4,
    stops=[0: RGB(255, 0, 0), 0.254: RGB(233, 136, 0), 0.5: RGB(254, 244, 84), 0.751: RGB(234, 126, 0), 1: RGB(255, 0, 0)])

# ----
mesh_color_by_face_3 = MeshColorByFace(Mesh=mesh_faces_3, Colors=gradient_2)

# ---- group: Visualise aspect as solid gradient (continued)
weld_mesh = WeldMesh(Mesh=mesh_color_by_face_3, Angle=3.141592654)
blur_mesh = BlurMesh(Mesh=weld_mesh, Iterations=blur_iterations)
