# Grasshopper definition Groundhog - Epaphic Effects.ghx (Grasshopper 0.9.76)

maximum_cell_offset = Slider(4, range=0..10)
minimum_cell_offset = Slider(2, range=0..10)
# Groundhog Project File
# This Grasshopper definition and its corresponding Rhinoceros model were developed by Albert Rex and Philip Belesky as part of the Groundhog project.
# 
# The definition and model are provided as speculative reverse-engineerings of how this landscape project could have been (partly) designed using computational methods. More information available at https://www.groundhog.la/projects/busan-cinema-complex/
# 
# This definition depends on components from version v0.9.1b of the Groundhog plugin. It is available for download at http://groundhog.la/plugin/
# 
# This definition is licensed under the terms of the GPL v3 https://opensource.org/licenses/GPL-3.0
cell_count_x = Slider(14, range=0..55)
cell_count_y = Slider(15, range=0..100)
curves_to_loft_into_surface = Curve([<curve referenced from the Rhino model> x4])

# ---- group: Orders input curves and lofts surface
point_on_curve = PointOnCurve(curves_to_loft_into_surface, parameter=0.5)
deconstruct = Deconstruct(Point=point_on_curve)  # -> XComponent, YComponent, ZComponent
sort_list = SortList(Keys=deconstruct.YComponent, ValuesValuesA=curves_to_loft_into_surface)  # -> Keys, ValuesValuesA
loft = Loft(
    Curves=sort_list.ValuesValuesA,
    Options={Adjust=False, Closed=False, LoftEnds=0, LoftSimp=0, LoftType=0, Rebuild=10, Refit=0.01})
lofted_base_surface = Surface(loft)

# ----
minimum_cell_offset_2 = Number(minimum_cell_offset)
maximum_cell_offset_2 = Number(maximum_cell_offset)

# ---- group: This cluster stretches a diamond grid over the top of the lofted surface
cluster = Cluster(v_count=cell_count_x, surface=lofted_base_surface, u_count=cell_count_y)
cell_curves = Curve(cluster)

# ---- group: Diamonds are broken down into corner points for construction of innner wall
control_points = ControlPoints(Curve=cell_curves)  # -> Points, Weights, Knots

# ---- group: Finds lowest and highest corner of each cell. Uses the vertical distance betweent these two points to calculate cell dilation
# This is where you could substitute in another factor to control the inner cell offsets. For example you could sample the area or aspect of each cell to inform how much it dilates.
deconstruct_2 = Deconstruct(Point=control_points.Points)  # -> XComponent, YComponent, ZComponent
minimum_cell_offset_3 = Number(minimum_cell_offset_2)
maximum_cell_offset_3 = Number(maximum_cell_offset_2)
sort_list_2 = SortList(Keys=deconstruct_2.ZComponent, ValuesValuesA=control_points.Points)  # -> Keys, ValuesValuesA
cell_corner_no = Slider(4, range=0..10)
cell_corner_no_2 = Slider(0, range=0..100)
list_item = ListItem(List=sort_list_2.ValuesValuesA, Index=cell_corner_no_2, Wrap=True)
list_item_2 = ListItem(List=sort_list_2.ValuesValuesA, Index=cell_corner_no, Wrap=True)
deconstruct_3 = Deconstruct(Point=list_item_2)  # -> XComponent, YComponent, ZComponent
deconstruct_4 = Deconstruct(Point=list_item)  # -> XComponent, YComponent, ZComponent
subtraction = Subtraction(A=deconstruct_3.ZComponent, B=deconstruct_4.ZComponent)  # -> flatten(Result)
point_no = Slider(0, range=0..100)
sort_list_3 = SortList(Keys=subtraction, ValuesValuesA=subtraction)  # -> Keys, ValuesValuesA
list_item_3 = ListItem(List=sort_list_3.ValuesValuesA, Index=0, Wrap=True)
list_item_4 = ListItem(List=sort_list_3.ValuesValuesA, Index=point_no, Wrap=True)
construct_domain = ConstructDomain(DomainStart=minimum_cell_offset_3, DomainEnd=maximum_cell_offset_3)
construct_domain_2 = ConstructDomain(DomainStart=list_item_4, DomainEnd=list_item_3)
remap_numbers = RemapNumbers(Value=sort_list_3.ValuesValuesA, Source=construct_domain_2, Target=construct_domain)  # -> Mapped, Clipped
offsets = Number(remap_numbers.Mapped)

# ---- group: Seperates out the 4 corner points of each cell
cell_corner_no_3 = Slider(0, range=0..10)
cell_corner_no_4 = Slider(2, range=0..10)
cell_corner_no_5 = Slider(1, range=0..10)
cell_corner_no_6 = Slider(3, range=0..10)
panel = Panel("""1
3""")
list_item_5 = ListItem(List=control_points.Points, Index=panel, Wrap=True)
list_item_6 = ListItem(List=control_points.Points, Index=cell_corner_no_5, Wrap=True)
list_item_7 = ListItem(List=control_points.Points, Index=cell_corner_no_6, Wrap=True)
list_item_8 = ListItem(List=control_points.Points, Index=cell_corner_no_4, Wrap=True)
list_item_9 = ListItem(List=control_points.Points, Index=cell_corner_no_3, Wrap=True)
point = Point(list_item_9)
point_2 = Point(list_item_6)
point_3 = Point(list_item_7)
point_4 = Point(list_item_5)
point_5 = Point(list_item_8)

# ----
cell_curves_2 = Curve(cell_curves)
point_6 = Point(point_5)
point_7 = Point(point_2)

# ---- group: Offsets walls of cells inward based on slope
point_8 = Point(point)
cell_offsets = Number(offsets)
cell_curves_3 = Curve(cell_curves_2)
point_9 = Point(point_3)
point_10 = Point(point_4)
vector_2pt = Vector2Pt(PointA=point_6, PointB=point_8, Unitize=False)  # -> Vector, Length
vector_2pt_2 = Vector2Pt(PointA=point_8, PointB=point_6, Unitize=False)  # -> Vector, Length
division = Division(A=flatten(vector_2pt.Vector), B=cell_offsets)
division_2 = Division(A=flatten(vector_2pt_2.Vector), B=cell_offsets)
move = Move(Geometry=flatten(point_8), Motion=division_2)  # -> Geometry, Transform
move_2 = Move(Geometry=flatten(point_6), Motion=division)  # -> Geometry, Transform
point_11 = Point([move.Geometry, move_2.Geometry])
point_in_curves = PointInCurves(Point=point_11, Curves=graft(cell_curves_3))  # -> Relationship, Index, Point
line = Line(StartPoint=point_7, EndPoint=point_9)
equality = Equality(FirstNumber=Slider(2, range=0..10), SecondNumber=point_in_curves.Relationship)  # -> Equality, Inequality
dispatch = Dispatch(List=point_11, DispatchPattern=equality.Equality)  # -> ListA, ListB
deconstruct_5 = Deconstruct(Point=dispatch.ListA)  # -> XComponent, YComponent, ZComponent
sort_list_4 = SortList(Keys=deconstruct_5.XComponent, ValuesValuesA=dispatch.ListA)  # -> Keys, ValuesValuesA
list_item_10 = ListItem(List=sort_list_4.ValuesValuesA, Index=0, Wrap=True)
list_item_11 = ListItem(List=sort_list_4.ValuesValuesA, Index=1, Wrap=True)
insert_items = InsertItems(List=point_10, Item=list_item_10, Indices=2, Wrap=True)
insert_items_2 = InsertItems(List=point_10, Item=list_item_11, Indices=2, Wrap=True)
sort_along_curve = SortAlongCurve(Points=insert_items_2, Curve=line)  # -> Points, Indices
sort_along_curve_2 = SortAlongCurve(Points=insert_items, Curve=line)  # -> Points, Indices
polyline = PolyLine(Vertices=sort_along_curve_2.Points, Closed=False)
polyline_2 = PolyLine(Vertices=sort_along_curve.Points, Closed=False)
cell_curves_4 = Curve(polyline)
cell_curves_5 = Curve(polyline_2)

# ----
cell_curves_6 = Curve(cell_curves_2)

# ---- group: Outer Cell Walls
curve = Curve(cell_curves_6)
custom_preview = CustomPreview(Geometry=curve, Shader=ColourSwatch(SwatchColor=RGB(255, 255, 255)))

# ---- group: Inner Cell Walls
curve_2 = Curve([cell_curves_4, cell_curves_5])
custom_preview_2 = CustomPreview(Geometry=curve_2, Shader=ColourSwatch(SwatchColor=RGB(0, 255, 25)))

# ==== cluster Cluster
surface = ClusterInput()
v_count = ClusterInput()
u_count = ClusterInput()

# ---- group: Ensure number of diamond West-points doesn't exceed surface columns
u_count_2 = Number(u_count)
division = Division(A=u_count_2, B=2)
round = Round(Number=division)  # -> Nearest, Floor, Ceiling
subtraction = Subtraction(A=round.Floor, B=1)

# ----
u_count_3 = Number(u_count_2)

# ---- group: Ensure number of diamond North-points doesn't exceed surface rows
v_count_2 = Number(v_count)
division_2 = Division(A=v_count_2, B=2)
round_2 = Round(Number=division_2)  # -> Nearest, Floor, Ceiling
subtraction_2 = Subtraction(A=round_2.Floor, B=1)

# ----
divide_surface = DivideSurface(Surface=surface, UCount=u_count_2, VCount=v_count_2)  # -> Points, Normals, Parameters
dispatch = Dispatch(List=divide_surface.Points, DispatchPattern=[True, False])  # -> ListA, ListB
flip_matrix = FlipMatrix(Data=dispatch.ListB)
dispatch_2 = Dispatch(List=flip_matrix, DispatchPattern=[True, False])  # -> ListA, ListB

# ---- group: Ensure number of diamond West-points doesn't exceed surface columns (continued)
sub_list = SubList(List=dispatch_2.ListA, Domain=subtraction, Wrap=False)  # -> List, Index

# ---- group: Offset that list to get South-points for diamonds
number_slider = Slider(1, range=0..10)
addition = Addition(A=subtraction_2, B=number_slider)
construct_domain = ConstructDomain(DomainStart=number_slider, DomainEnd=addition)
sub_list_2 = SubList(List=dispatch.ListA, Domain=construct_domain, Wrap=False)  # -> List, Index

# ---- group: Offset that list to get East points for diamonds
number_slider_2 = Slider(1, range=0..10)
addition_2 = Addition(A=subtraction_2, B=number_slider_2)
construct_domain_2 = ConstructDomain(DomainStart=number_slider_2, DomainEnd=addition_2)
sub_list_3 = SubList(List=dispatch_2.ListA, Domain=construct_domain_2, Wrap=False)  # -> List, Index

# ---- group: Ensure number of diamond North-points doesn't exceed surface rows (continued)
sub_list_4 = SubList(List=dispatch.ListA, Domain=subtraction_2, Wrap=False)  # -> List, Index

# ---- group: Pattern Phase 1
flip_matrix_2 = FlipMatrix(Data=sub_list_4.List)
flip_matrix_3 = FlipMatrix(Data=sub_list_2.List)
point = Point(graft(sub_list_3.List))
dispatch_3 = Dispatch(List=flip_matrix_3, DispatchPattern=[True, False])  # -> ListA, ListB
dispatch_4 = Dispatch(List=flip_matrix_2, DispatchPattern=[True, False])  # -> ListA, ListB
point_2 = Point(graft(dispatch_3.ListB))
point_3 = Point(graft(dispatch_4.ListB))
point_4 = Point(graft(sub_list.List))
create_pattern_a = Merge(Data1=point_3, Data2=point_4, Data3=point_2, Data4=point, Data5=point_3)
polyline = PolyLine(Vertices=create_pattern_a, Closed=False)  # -> flatten(Polyline)

# ---- group: Pattern Phase 2
trim_tree = TrimTree(Tree=point, Depth=1)
addition_3 = Addition(A=u_count_3, B=1)
trim_tree_2 = TrimTree(Tree=simplify(point_2), Depth=1)
list_length = ListLength(List=trim_tree)
modulus = Modulus(A=addition_3, B=Slider(2, range=0..10))
subtraction_3 = Subtraction(A=list_length, B=Slider(1, range=0..1))
subtraction_4 = Subtraction(A=subtraction_3, B=modulus)
tree_statistics = TreeStatistics(Tree=trim_tree_2)  # -> Paths, Length, Count
sub_list_5 = SubList(List=trim_tree, Domain=subtraction_4, Wrap=False)  # -> List, Index
subtraction_5 = Subtraction(A=tree_statistics.Count, B=1)
point_5 = Point(sub_list_5.List)
construct_path = ConstructPath(Indices=subtraction_5)
split_tree = SplitTree(Data=simplify(trim_tree_2), Masks=flatten(construct_path))  # -> Positive, Negative
tree_statistics_2 = TreeStatistics(Tree=point_5)  # -> Paths, Length, Count
subtraction_6 = Subtraction(A=tree_statistics_2.Count, B=1)
cull_index = CullIndex(List=split_tree.Negative, Indices=0, Wrap=True)
cull_index_2 = CullIndex(List=split_tree.Negative, Indices=-1, Wrap=True)
construct_path_2 = ConstructPath(Indices=subtraction_6)
east = Point(flatten(cull_index))
west = Point(flatten(cull_index_2))
split_tree_2 = SplitTree(Data=simplify(point_5), Masks=flatten("{0}"))  # -> Positive, Negative
split_tree_3 = SplitTree(Data=simplify(point_5), Masks=flatten(construct_path_2))  # -> Positive, Negative
south = Point(flatten(split_tree_2.Negative))
north = Point(flatten(split_tree_3.Negative))
east_2 = CustomPreview(Geometry=east, Material=ColourSwatch(SwatchColor=RGB(0, 0, 0)))
west_2 = CustomPreview(Geometry=west, Material=ColourSwatch(SwatchColor=RGB(244, 0, 255)))
norths = CustomPreview(Geometry=south, Material=ColourSwatch(SwatchColor=RGB(255, 255, 255)))
south_2 = CustomPreview(Geometry=north, Material=ColourSwatch(SwatchColor=RGB(120, 244, 255)))
merge = Merge(Data1=graft(south), Data2=graft(east), Data3=graft(north), Data4=graft(west), Data5=graft(south))
polyline_2 = PolyLine(Vertices=merge, Closed=False)  # -> flatten(Polyline)

# ----
curve = Curve([polyline, polyline_2])
curve_2 = ClusterOutput(curve)
