# Grasshopper definition Groundhog - Max IV Laboratory.ghx (Grasshopper 0.9.76)

# ----
# Groundhog Project File
# This Grasshopper definition and its corresponding Rhinoceros model were developed by Philip Belesky as part of the Groundhog project.
# 
# The definition and model are provided as speculative reverse-engineerings of how this landscape project could have been (partly) designed using computational methods. More information available at https://www.groundhog.la/projects/max-iv-laboratory/
# 
# This definition depends on components from version v0.9.1b of the Groundhog plugin. It is available for download at http://groundhog.la/plugin/
# 
# This definition is licensed under the terms of the GPL v3 https://opensource.org/licenses/GPL-3.0
center_point = Point(<point referenced from the Rhino model>)

curve_count = Slider(64, range=0..100)
curve_length = Slider(413569, range=0..1000000)
curve_points = Slider(38, range=0..100)

curve_length_2 = Number(curve_length)
curve_count_2 = Number(curve_count)
circle_cnr = CircleCNR(Center=center_point, Normal=Vector(0, 0, 1), Radius=Slider(110000, range=0..1000000))
curve_points_2 = Number(curve_points)

# ---- group: Rotate the ring slightly to precisely align other tangents
building_façade = Circle(circle_cnr)
rotation = Slider(0.3, range=0..1)
deconstruct_arc = DeconstructArc(Arc=building_façade)  # -> BasePlane, Radius, Angle
rotate = Rotate(Geometry=building_façade, Angle=rotation, Plane=deconstruct_arc.BasePlane)  # -> Geometry, Transform

# ---- group: Straight tangents
# count of 40 matches basemap
# angle of 221 matches basemap
tangent_count = Slider(80, range=0..100)
tangent_rotation = Slider(221, range=0..360)
tangent_extension = Slider(336103, range=100000..400000)
building_façade_2 = Circle(circle_cnr)
radians = Radians(Degrees=tangent_rotation)
divide_curve = DivideCurve(Curve=building_façade_2, Count=tangent_count, Kinks=False)  # -> Points, Tangents, Parameters
xy_plane = XYPlane(Origin=Point(0, 0, 0))
rotate_2 = Rotate(Vector=divide_curve.Tangents, Axis=xy_plane, Angle=radians)
multiplication = Multiplication(A=rotate_2, B=tangent_extension)
move = Move(Geometry=divide_curve.Points, Motion=multiplication)  # -> Geometry, Transform
line = Line(StartPoint=divide_curve.Points, EndPoint=move.Geometry)

# ---- group: Create tangents
curve_length_3 = Number(curve_length_2)
curve_count_3 = Number(curve_count_2)
divide_curve_2 = DivideCurve(Curve=rotate.Geometry, Count=curve_count_3, Kinks=False)  # -> Points, Tangents, Parameters
xy_plane_2 = XYPlane(Origin=Point(0, 0, 0))
multiplication_2 = Multiplication(A=divide_curve_2.Tangents, B=curve_length_3)
rotate_3 = Rotate(Vector=multiplication_2, Axis=xy_plane_2, Angle=Slider(5.8, range=0..6.2))
move_2 = Move(Geometry=divide_curve_2.Points, Motion=rotate_3)  # -> Geometry, Transform
line_2 = Line(StartPoint=divide_curve_2.Points, EndPoint=move_2.Geometry)

# ---- group: Create Spirals
exagerration = Slider(575137, range=0..1000000)
curve_points_3 = Number(curve_points_2)
divide_curve_3 = DivideCurve(Curve=line_2, Count=curve_points_3, Kinks=False)  # -> Points, Tangents, Parameters
range = Range(Domain=Domain(0, 1), Steps=curve_points_3)
xy_plane_3 = XYPlane(Origin=Point(0, 0, 0))
curve_arc = GraphMapper(
    range,
    x0=0,
    x1=1,
    y0=0,
    y1=1,
    container_name="Bezier",
    cpx=[0, 0.3315213323, 0.746117115, 1],
    cpy=[0, 0, 0.3666873574, 0.6447191238])
cross_product = CrossProduct(VectorA=xy_plane_3, VectorB=divide_curve_3.Tangents, Unitize=False)  # -> simplify(Vector), Length
multiplication_3 = Multiplication(A=curve_arc, B=exagerration)
multiplication_4 = Multiplication(A=multiplication_3, B=cross_product.Vector)
move_3 = Move(Geometry=simplify(divide_curve_3.Points), Motion=multiplication_4)  # -> Geometry, Transform
interpolate = Interpolate(Vertices=move_3.Geometry, Degree=3, Periodic=False, KnotStyle=1)  # -> Curve, Length, Domain

# ---- group: Find intersections
curved_tangents = Curve(flatten(interpolate.Curve))
straight_tangents = Curve(flatten(line))
dispatch = Dispatch(List=straight_tangents, DispatchPattern=[True, False])  # -> ListA, ListB
dispatch_2 = Dispatch(List=curved_tangents, DispatchPattern=invert([True, False]))  # -> ListA, ListB
lines_b_2 = Curve(dispatch.ListB)
lines_a_1 = Curve(dispatch_2.ListA)
lines_b_1 = Curve(dispatch_2.ListB)
lines_a_2 = Curve(dispatch.ListA)
curve_curve = CurveCurve(CurveA=graft(lines_b_1), CurveB=lines_b_2)  # -> Points, ParamsA, ParamsB
curve_curve_2 = CurveCurve(CurveA=graft(lines_a_1), CurveB=lines_a_2)  # -> Points, ParamsA, ParamsB
trim_tree = TrimTree(Tree=curve_curve.Points, Depth=1)  # -> simplify(Tree)
trim_tree_2 = TrimTree(Tree=curve_curve_2.Points, Depth=1)  # -> simplify(Tree)
node_intersections = Point(trim_tree)
node_intersections_2 = Point(trim_tree_2)

# ----
lines_a_2_2 = Curve(lines_a_2)
lines_a_1_2 = Curve(lines_a_1)
lines_b_2_2 = Curve(lines_b_2)
lines_b_1_2 = Curve(lines_b_1)

# ---- group: Find intersections (continued)
lines_a = Curve([lines_a_1_2, lines_a_2_2])
lines_b = Curve([lines_b_1_2, lines_b_2_2])

# ----
lines_b_3 = Curve(lines_b)
lines_a_3 = Curve(lines_a)

# ---- group: Rebuild the curves to have a precise order that matches the original (CCX messes this up)
polyline = PolyLine(Vertices=node_intersections, Closed=True)
explode = Explode(Curve=polyline, Recursive=True)  # -> Segments, Vertices
length = Length(Curve=explode.Segments)
list_length = ListLength(List=explode.Segments)
sort_list = SortList(Keys=length, ValuesValuesA=explode.Segments)  # -> Keys, ValuesValuesA
subtraction = Subtraction(A=list_length, B=1)
split_list = SplitList(List=sort_list.ValuesValuesA, Index=subtraction)  # -> ListA, ListB
join_curves = JoinCurves(Curves=split_list.ListA, Preserve=False)
explode_2 = Explode(Curve=join_curves, Recursive=True)  # -> Segments, Vertices

polyline_2 = PolyLine(Vertices=node_intersections_2, Closed=True)
explode_3 = Explode(Curve=polyline_2, Recursive=True)  # -> Segments, Vertices
length_2 = Length(Curve=explode_3.Segments)
list_length_2 = ListLength(List=explode_3.Segments)
sort_list_2 = SortList(Keys=length_2, ValuesValuesA=explode_3.Segments)  # -> Keys, ValuesValuesA
subtraction_2 = Subtraction(A=list_length_2, B=1)
split_list_2 = SplitList(List=sort_list_2.ValuesValuesA, Index=subtraction_2)  # -> ListA, ListB
join_curves_2 = JoinCurves(Curves=split_list_2.ListA, Preserve=False)

# ----
explode_4 = Explode(Curve=join_curves_2, Recursive=True)  # -> Segments, Vertices
curve = Curve(explode_4.Segments)
point_on_curve = PointOnCurve(curve, parameter=0.5)
point_on_curve_2 = PointOnCurve(curve, parameter=0)
weave = Weave(Pattern=[0, 1], Stream0=point_on_curve_2, Stream1=point_on_curve, NullGaps=False)  # -> simplify(Weave)

# ---- group: Create Mount Heights
curve_2 = Curve(explode_2.Segments)
point_on_curve_3 = PointOnCurve(curve_2, parameter=0.5)
point_on_curve_4 = PointOnCurve(curve_2, parameter=0)
mount_height_increase = Slider(500, range=0..1000)
list_length_3 = ListLength(List=point_on_curve_4)
series = Series(Start=0, Step=mount_height_increase, Count=list_length_3)
unit_z = UnitZ(Factor=series)
move_4 = Move(Geometry=point_on_curve_4, Motion=unit_z)  # -> Geometry, Transform
weave_2 = Weave(Pattern=[0, 1], Stream0=move_4.Geometry, Stream1=point_on_curve_3, NullGaps=False)  # -> simplify(Weave)

# ---- group: Assemble curves for loft
end_points = EndPoints(Curve=lines_a_1_2)  # -> simplify(graft(Start)), simplify(graft(End))
end_points_2 = EndPoints(Curve=lines_b_1_2)  # -> simplify(graft(Start)), simplify(graft(End))
merge = Merge(Data1=end_points_2.Start, Data2=weave_2, Data3=end_points_2.End)
merge_2 = Merge(Data1=end_points.Start, Data2=weave, Data3=end_points.End)
number_slider = Slider(422402, range=0..1000000)
interpolate_2 = Interpolate(Vertices=merge_2, Degree=3, Periodic=False, KnotStyle=1)  # -> Curve, Length, Domain
interpolate_3 = Interpolate(Vertices=merge, Degree=3, Periodic=False, KnotStyle=1)  # -> Curve, Length, Domain
divide_distance = DivideDistance(Curve=interpolate_2.Curve, Distance=number_slider)  # -> Points, Tangents, Parameters
divide_distance_2 = DivideDistance(Curve=interpolate_3.Curve, Distance=number_slider)  # -> Points, Tangents, Parameters
list_item = ListItem(List=divide_distance.Parameters, Index=1, Wrap=True)
list_item_2 = ListItem(List=divide_distance_2.Parameters, Index=1, Wrap=True)
sub_curve = SubCurve(BaseCurve=interpolate_2.Curve, Domain=list_item)
sub_curve_2 = SubCurve(BaseCurve=interpolate_3.Curve, Domain=list_item_2)
weave_3 = Weave(Pattern=[0, 1], Stream0=flatten(sub_curve_2), Stream1=flatten(sub_curve), NullGaps=False)
loft = Loft(Curves=flatten(weave_3), Options={Adjust=False, Closed=True, LoftEnds=0, LoftSimp=0, LoftType=0, Rebuild=10, Refit=0.01})
overall_surface = Surface(loft)

# ----
lines_b_4 = Curve(lines_b_3)
overall_surface_2 = Surface(overall_surface)
lines_a_4 = Curve(lines_a_3)
custom_preview = CustomPreview(Geometry=overall_surface_2, Shader=ColourSwatch(SwatchColor=RGB(199, 199, 199)))
custom_preview_2 = CustomPreview(Geometry=lines_a_4, Shader=ColourSwatch(SwatchColor=RGB(255, 255, 255)))
custom_preview_3 = CustomPreview(Geometry=lines_b_4, Shader=ColourSwatch(SwatchColor=RGB(255, 255, 0)))
