# Grasshopper definition Groundhog - Sony Forest.ghx (Grasshopper 0.9.76)

# This Grasshopper definition and its corresponding Rhinoceros model were developed by Albert Rex and Philip Belesky as part of the Groundhog project.
# 
# The definition and model are provided as speculative reverse-engineerings of how this landscape project could have been (partly) designed using computational methods. More information available at https://www.groundhog.la/projects/sony-forest/
# 
# This definition depends on components from version v0.9.1b of the Groundhog plugin. It is available for download at http://groundhog.la/plugin/
# 
# This definition is licensed under the terms of the GPL v3 https://opensource.org/licenses/GPL-3.0
paver_y_grid_spacing = Slider(3, range=0..10)
paver_x_grid_spacing = Slider(3, range=0..10)
# Groundhog Project File
garden_perimiter = Curve(<curve referenced from the Rhino model>)
boundary_surfaces = BoundarySurfaces(Edges=garden_perimiter)

# ---- group: Get Contours from layer
landform = Surface(boundary_surfaces)

# ----
buildings = Curve([<curve referenced from the Rhino model> x3])

# ---- group: Get maximum x/y dimensions of each patch; use those to determine the grid size
bounding_box = BoundingBox(Content=landform, Plane=PlaneXY(0, 0, 0))  # -> Box, Box_2
deconstruct_box = DeconstructBox(Box=bounding_box.Box)  # -> Plane, X, Y, Z
deconstruct_domain = DeconstructDomain(Domain=deconstruct_box.Y)  # -> Start, End
deconstruct_domain_2 = DeconstructDomain(Domain=deconstruct_box.X)  # -> Start, End
z_domain = Domain(deconstruct_box.Z)

# ----
subtraction = Subtraction(A=deconstruct_domain_2.End, B=deconstruct_domain_2.Start)
subtraction_2 = Subtraction(A=deconstruct_domain.End, B=deconstruct_domain.Start)

# ---- group: Get maximum x/y dimensions of each patch; use those to determine the grid size (continued)
maximum_x = Number(subtraction)
maximum_y = Number(subtraction_2)

# ---- group: Divide up each surface using the predefined grid distance (won't be perfectly square; but good enough)
division = Division(A=maximum_x, B=paver_y_grid_spacing)
division_2 = Division(A=maximum_y, B=paver_x_grid_spacing)
divide_surface = DivideSurface(Surface=landform, UCount=division, VCount=division_2)  # -> flatten(Points), Normals, Parameters
null_item = NullItem(Item=divide_surface.Points)  # -> NullFlags, InvalidFlags, Description
cull_pattern = CullPattern(List=divide_surface.Points, CullPattern=invert(null_item.InvalidFlags))
paving_origins = Point(cull_pattern)

# ----
point_in_curves = PointInCurves(Point=paving_origins, Curves=buildings)  # -> Relationship, Index, Point
equality = Equality(FirstNumber=point_in_curves.Relationship, SecondNumber=0)  # -> Equality, Inequality
dispatch = Dispatch(List=paving_origins, DispatchPattern=equality.Equality)  # -> ListA, ListB
trimmed_paving_origins = Point(dispatch.ListA)

gardne_walking_path = Curve(<curve referenced from the Rhino model>)
fidelity_with_which_path_influences_pavi = Slider(100, range=0..100)  # "Fidelity with which Path influences paving"
no_of_grid_points_influenced_by_path = Slider(10, range=0..10)
divide_curve = DivideCurve(Curve=gardne_walking_path, Count=fidelity_with_which_path_influences_pavi, Kinks=False)  # -> Points, Tangents, Parameters
closest_points = ClosestPoints(Point=divide_curve.Points, Cloud=trimmed_paving_origins, Count=no_of_grid_points_influenced_by_path)  # -> ClosestPoint, CPIndex, Distance
cull_index = CullIndex(List=trimmed_paving_origins, Indices=flatten(closest_points.CPIndex), Wrap=True)
trimmed_paver_origins = Point(cull_index)

# ---- group: Uses Panting attractor points to define planting area
planting_attractors = Point([<point referenced from the Rhino model> x92])
closest_points_2 = ClosestPoints(Point=planting_attractors, Cloud=dispatch.ListA, Count=3)  # -> ClosestPoint, CPIndex, Distance
metaball_t = MetaBallT(Points=flatten(closest_points_2.ClosestPoint), Plane=PlaneXY(0, 0, 0), Threshold=Slider(0.5, range=0..1))
planting_area = Curve(metaball_t)

# ---- group: Generates gradient between square and voronoi grid based on attractor points
attractor_strength = Slider(102.4, range=0..200)
min_domain = Slider(0.24, range=0..1)
max_domain = Slider(16.07, range=0..20)
paving_attractors = Point(graft([<point referenced from the Rhino model> x23]))
closest_points_3 = ClosestPoints(Point=paving_attractors, Cloud=trimmed_paver_origins, Count=Slider(10, range=0..10))  # -> ClosestPoint, CPIndex, Distance
division_3 = Division(A=attractor_strength, B=closest_points_3.Distance)
vector_2pt = Vector2Pt(PointA=closest_points_3.ClosestPoint, PointB=paving_attractors, Unitize=False)  # -> Vector, Length
cull_index_2 = CullIndex(List=trimmed_paver_origins, Indices=flatten(closest_points_3.CPIndex), Wrap=True)
maximum = Maximum(A=division_3, B=min_domain)
minimum = Minimum(A=maximum, B=max_domain)
amplitude = Amplitude(Vector=vector_2pt.Vector, Amplitude=minimum)
move = Move(Geometry=closest_points_3.ClosestPoint, Motion=amplitude)  # -> Geometry, Transform
merge = Merge(Data1=move.Geometry, Data2=cull_index_2)
voronoi = Voronoi(Points=flatten(merge), BruteForceOverride=False)
trim_with_regions = TrimWithRegions(Curve=voronoi, Regions=buildings)  # -> Inside, Outside
trim_with_region = TrimWithRegion(Curve=trim_with_regions.Outside, Region=garden_perimiter)  # -> Inside, Outside
trim_with_regions_2 = TrimWithRegions(Curve=trim_with_region.Inside, Regions=planting_area)  # -> Inside, Outside
trimmed_paving = Curve(trim_with_regions_2.Outside)

# ---- group: Projects paving and planting areas onto 3d base surface
ground = Surface(<surface referenced from the Rhino model>)
project = Project(Curve=[trimmed_paving, planting_area], Brep=ground, Direction=Vector(0, 0, 1))
project_point = ProjectPoint(Point=closest_points_2.ClosestPoint, Direction=Vector(0, 0, -1), Geometry=ground)  # -> Point, Index
tree_base_points = Point(project_point.Point)

# ---- group: Populates planting areas with trees
list_length = ListLength(List=tree_base_points)
construct_domain = ConstructDomain(DomainStart=Slider(1, range=0..1), DomainEnd=Slider(6, range=0..10))
random = Random(Range=construct_domain, Number=list_length, Seed=2)
unit_z = UnitZ(Factor=random)
division_4 = Division(A=random, B=Slider(2, range=0..10))
move_2 = Move(Geometry=tree_base_points, Motion=unit_z)  # -> Geometry, Transform
line = Line(StartPoint=tree_base_points, EndPoint=move_2.Geometry)
sphere = Sphere(Base=move_2.Geometry, Radius=division_4)
pipe = Pipe(Curve=line, Radius=Slider(0.25, range=0..1), Caps=0)

# ----
group = Group([pipe, sphere, project_point.Point, project])
