# Grasshopper definition Groundhog - South Park.ghx (Grasshopper 1.0.7)

# ---- group: Define the amount of path distortion according to each attractor type
# The “A” type atttractor distorts the ‘spine’ of the path, changing its overall direction.
# The “B” type atttractor distorts the outer edges of the path, changing the path’s width.
max_radius_of_b_attractors = Slider(20691, range=5000..50000)
pull_force_of_b_attractors = Slider(618, range=-2000..10000)
pull_force_of_a_attractors = Slider(9501, range=-2000..20000)
pull_force_of_b_attractors_2 = Number(pull_force_of_b_attractors)
pull_force_of_a_attractors_2 = Number(pull_force_of_a_attractors)
max_radius_of_b_attractors_2 = Number(max_radius_of_b_attractors)

# ----
max_radius_of_a_attractors = Slider(35189, range=5000..50000)

# ---- group: Main path direction
# Groundhog Project File
# This Grasshopper definition and its corresponding Rhinoceros model were developed by Albert Rex and Philip Belesky as part of the Groundhog project.
# 
# The definition and model are provided as speculative reverse-engineerings of how this landscape project could have been (partly) designed using computational methods. More information available at https://groundhog.philipbelesky.com/projects/south-park/
# 
# This definition depends on components from version v0.13.0 of the Groundhog plugin. It is available for download at http://groundhog.philipbelesky.com/plugin/
# The central axis curve is the default shape of the path (which it is then pulled away from via the attractors).
# The site boundary is used to trim the portions of the path that are outside of it.
path_points_count = Slider(167, range=0..1000)
base_path_width = Slider(2306, range=0..5000)
path_central_axis = Curve(<curve referenced from the Rhino model>)
site_boundary = Curve(<curve referenced from the Rhino model>)
base_path_width_2 = Number(base_path_width)
path_divisions = Integer(path_points_count)

# ---- group: The dimensions of the tiles
paver_fillet = Slider(1000, range=0..1000)
paver_maximum_length = Slider(15000, range=1000..20000)
paver_width = Slider(900, range=0..1000)
paver_max_length = Number(paver_maximum_length)
paver_width_2 = Number(paver_width)
fillet = Number(paver_fillet)

# ----
max_radius_of_a_attractors_2 = Number(max_radius_of_a_attractors)
geometry_pipeline = GeometryPipeline(
    GroupByLayer=False,
    GroupByType=False,
    IncludeHidden=True,
    IncludeLocked=True,
    LayerFilter="Attractors A",
    NameFilter="*",
    SublayerFiltering=False,
    TypeFilter=1)

# ---- group: Divide the central path line into points and then pull those points towards the type A attractor circles
# This logic is repeated for each of the three attractor types so has been clustered
pull_force_of_a_attractors_3 = Number(pull_force_of_a_attractors_2)
max_radius_of_a_attractors_3 = Number(max_radius_of_a_attractors_2)
path_central_axis_2 = Curve(path_central_axis)
path_divisions_2 = Integer(path_divisions)
pull_path = PullPath(
    path_central_axis=path_central_axis_2,
    path_divisions=path_divisions_2,
    attractors=geometry_pipeline,
    pull_force=pull_force_of_a_attractors_3,
    max_radius=max_radius_of_a_attractors_3)  # -> path_center_2, attractor_lines_2
attractor_lines = Geometry(pull_path.attractor_lines_2)
path_center = Curve(pull_path.path_center_2)

# ---- group: Make tile outlines by dividing the main axis into points then offsetting those at tangents
paver_height = Number(paver_max_length)
path_central_axis_3 = Curve(path_central_axis)
paver_width_3 = Number(paver_width_2)
unit_z = UnitZ(Factor=1)
divide_distance = DivideDistance(Curve=path_central_axis_3, Distance=paver_width_3)  # -> graft(Points), graft(Tangents), Parameters
cross_product = CrossProduct(VectorA=divide_distance.Tangents, VectorB=unit_z, Unitize=False)  # -> Vector, Length
multiplication = Multiplication(A=cross_product.Vector, B=paver_height)
negative = Negative(Value=multiplication)
move = Move(Geometry=divide_distance.Points, Motion=negative)  # -> Geometry, Transform
move_2 = Move(Geometry=divide_distance.Points, Motion=multiplication)  # -> Geometry, Transform
line = Line(StartPoint=move_2.Geometry, EndPoint=move.Geometry)  # -> flatten(Line)
paver_outlines = Line(line)

# ---- group: Create a generic offset
base_path_width_3 = Number(base_path_width_2)
path_center_2 = Curve(path_center)
negative_2 = Negative(Value=base_path_width_3)
offset = Offset(Curve=path_center_2, Distance=base_path_width_3, Plane=PlaneXY(0, 0, 0), Corners=1)
offset_2 = Offset(Curve=path_center_2, Distance=negative_2, Plane=PlaneXY(0, 0, 0), Corners=1)
path_edges = Curve([offset, offset_2])

# ---- group: Repeat the same division and pull process with the second set of attractor points
geometry_pipeline_2 = GeometryPipeline(
    GroupByLayer=False,
    GroupByType=False,
    IncludeHidden=True,
    IncludeLocked=True,
    LayerFilter="Attractors B",
    NameFilter="*",
    SublayerFiltering=False,
    TypeFilter=1)
path_edges_2 = Curve(path_edges)
pull_force_of_b_attractors_3 = Number(pull_force_of_b_attractors_2)
max_radius_of_b_attractors_3 = Number(max_radius_of_b_attractors_2)
path_divisions_3 = Integer(path_divisions)
pull_path_2 = PullPath(
    path_central_axis=path_edges_2,
    path_divisions=path_divisions_3,
    attractors=geometry_pipeline_2,
    pull_force=pull_force_of_b_attractors_3,
    max_radius=max_radius_of_b_attractors_3)  # -> path_center_2, attractor_lines_2
attractor_lines_2 = Geometry(pull_path_2.attractor_lines_2)
path_edges_3 = Curve(pull_path_2.path_center_2)

# ---- group: Join the two path boundaries together
path_edges_4 = Curve(path_edges_3)
end = EndPoints(Curve=path_edges_4)  # -> Start, End
dispatch = Dispatch(List=flatten(end.End), DispatchPattern=[True, False])  # -> ListA, ListB
dispatch_2 = Dispatch(List=flatten(end.Start), DispatchPattern=[True, False])  # -> ListA, ListB
ln = Line(StartPoint=dispatch_2.ListA, EndPoint=dispatch_2.ListB)
ln_2 = Line(StartPoint=dispatch.ListA, EndPoint=dispatch.ListB)
join_curves = JoinCurves(Curves=flatten([path_edges_4, ln, ln_2]), Preserve=False)
path_outline = Curve(join_curves)

# ---- group: Trim Path to Site Boundary
site_boundary_2 = Curve(site_boundary)
path_outline_2 = Curve(path_outline)
trim_with_region = TrimWithRegion(Curve=site_boundary_2, Region=path_outline_2)  # -> Inside, Outside
trim_with_region_2 = TrimWithRegion(Curve=path_outline_2, Region=site_boundary_2)  # -> Inside, Outside
join_curves_2 = JoinCurves(Curves=flatten([trim_with_region_2.Inside, trim_with_region.Inside]), Preserve=False)
trimmed_path_outline = Curve(join_curves_2)

# ---- group: Combine path and boundary of the tiles (this sets up a clean trim)
paver_outlines_2 = Line(paver_outlines)
path_outline_3 = Curve(trimmed_path_outline)
bounding_box = BoundingBox(Content=paver_outlines_2, Plane=PlaneXY(0, 0, 0), UnionBox=True)  # -> Box, Box_2
deconstruct_brep = DeconstructBrep(Brep=bounding_box.Box)  # -> Faces, Edges, Vertices
trim_with_region_3 = TrimWithRegion(Curve=deconstruct_brep.Faces, Region=path_outline_3)  # -> Inside, Outside
trim_with_region_4 = TrimWithRegion(Curve=path_outline_3, Region=deconstruct_brep.Faces)  # -> Inside, Outside
join_curves_3 = JoinCurves(Curves=flatten([trim_with_region_3.Inside, trim_with_region_4.Inside]), Preserve=False)

# ---- group: Trim the tiles down to the boundary
paver_outlines_3 = Line(paver_outlines)
curve_line = CurveLine(Curve=graft(join_curves_3), Line=paver_outlines_3)  # -> Points, Params, Count
prune_tree = PruneTree(Tree=curve_line.Points, Minimum=Slider(2, range=0..10), Maximum=0)
interpolate = Interpolate(Vertices=prune_tree, Degree=3, Periodic=False, KnotStyle=1)  # -> Curve, Length, Domain
trimmed_tile_outlines = Curve(interpolate.Curve)

# ---- group: Make tile edges including fillet
fillet_2 = Number(fillet)
trimmed_tile_outlines_2 = Curve(trimmed_tile_outlines)
paver_width_4 = Number(paver_width_2)
multiplication_2 = Multiplication(A=paver_width_4, B=fillet_2)
list_item = ListItem(List=flatten(trimmed_tile_outlines_2), Index=0, Wrap=True)
evaluate_curve = EvaluateCurve(Curve=list_item, Parameter=0)  # -> Point, Tangent, Angle
unit_z_2 = UnitZ(Factor=1)
cross_product_2 = CrossProduct(VectorA=evaluate_curve.Tangent, VectorB=unit_z_2, Unitize=False)  # -> Vector, Length
multiplication_3 = Multiplication(A=paver_width_4, B=cross_product_2.Vector)
move_3 = Move(Geometry=trimmed_tile_outlines_2, Motion=multiplication_3)  # -> Geometry, Transform
end_points = EndPoints(Curve=simplify(trimmed_tile_outlines_2))  # -> Start, End
end_points_2 = EndPoints(Curve=simplify(move_3.Geometry))  # -> Start, End
interpolate_2 = Interpolate(Vertices=[end_points.Start, end_points_2.Start, end_points_2.End, end_points.End], Degree=1, Periodic=True, KnotStyle=1)  # -> Curve, Length, Domain
fillet_3 = Fillet(Curve=interpolate_2.Curve, Radius=multiplication_2)
tile_outlines = Geometry(fillet_3)

# ---- group: Visualise Pavers
tile_outlines_2 = Geometry(tile_outlines)
make_tile_surfaces = MakeTileSurfaces(tile_outlines=tile_outlines_2)
custom_preview = CustomPreview(Geometry=tile_outlines_2, Shader=ColourSwatch(SwatchColor=RGBA(0, 0, 0, 71)))

# ---- group: Visualise Attractors B
path_center_3 = Curve(path_edges_3)
attractors_b_lines = Geometry(attractor_lines_2)
custom_preview_2 = CustomPreview(Geometry=path_center_3, Shader=ColourSwatch(SwatchColor=RGB(148, 255, 243)))
custom_preview_3 = CustomPreview(Geometry=attractors_b_lines, Shader=ColourSwatch(SwatchColor=RGB(0, 255, 225)))

# ---- group: Visualise Attractors A
path_center_4 = Curve(path_center)
attractors_a_lines = Geometry(attractor_lines)
custom_preview_4 = CustomPreview(Geometry=path_center_4, Shader=ColourSwatch(SwatchColor=RGB(255, 0, 224)))
custom_preview_5 = CustomPreview(Geometry=attractors_a_lines, Shader=ColourSwatch(SwatchColor=RGB(128, 0, 113)))

# ==== cluster PullPath
max_radius = ClusterInput()
path_central_axis = ClusterInput()
path_divisions = ClusterInput()
attractors = ClusterInput()
pull_force = ClusterInput()
path_central_axis_2 = Curve(path_central_axis)
path_divisions_2 = Integer(path_divisions)
attractors_2 = Geometry(attractors)
max_radius_2 = Number(max_radius)
pull_force_2 = Number(pull_force)
divide_curve = DivideCurve(Curve=path_central_axis_2, Count=path_divisions_2, Kinks=False)  # -> Points, Tangents, Parameters
closest_point = ClosestPoint(Point=divide_curve.Points, Cloud=attractors_2)  # -> ClosestPoint, CPIndex, Distance
vector_2pt = Vector2Pt(PointA=divide_curve.Points, PointB=closest_point.ClosestPoint, Unitize=False)  # -> Vector, Length
smaller = SmallerThan(FirstNumber=closest_point.Distance, SecondNumber=max_radius_2)  # -> SmallerThan, OrEqualTo
num = Number(smaller.SmallerThan)
amplitude = Amplitude(Vector=vector_2pt.Vector, Amplitude=pull_force_2)
amplitude_2 = Amplitude(Vector=vector_2pt.Vector, Amplitude="0")
p_n_c = PickNChoose(Pattern=num, Stream0=amplitude_2, Stream1=amplitude)
move = Move(Geometry=divide_curve.Points, Motion=p_n_c)  # -> Geometry, Transform
ln = Line(StartPoint=divide_curve.Points, EndPoint=move.Geometry)
line = Line(StartPoint=closest_point.ClosestPoint, EndPoint=move.Geometry)
interpolate = Interpolate(Vertices=move.Geometry, Degree=3, Periodic=False, KnotStyle=1)  # -> Curve, Length, Domain
cull = CullPattern(List=line, CullPattern=smaller.SmallerThan)
culln = CullNth(List=cull, CullFrequency=2)
attractor_lines = Geometry(culln)
path_center = Curve(interpolate.Curve)
attractor_lines_2 = ClusterOutput(attractor_lines)
path_center_2 = ClusterOutput(path_center)

# ==== cluster MakeTileSurfaces
tile_outlines = ClusterInput()
tile_outlines_2 = Geometry(tile_outlines)
explode = Explode(Curve=tile_outlines_2, Recursive=True)  # -> Segments, Vertices
length = Length(Curve=explode.Segments)
list_length = ListLength(List=explode.Segments)
sort_list = SortList(Keys=length, ValuesValuesA=explode.Segments)  # -> Keys, ValuesValuesA
subtraction = Subtraction(A=list_length, B=Slider(3, range=0..10))
# We could replace this block with just a Boundary Surface component; however that becomes slow when dealing with a large number of tiles. Instead we identify the curves of the filleted arc-ends (by removing the two longest segments) and then loft those.
sub_list = SubList(List=sort_list.ValuesValuesA, Domain=subtraction, Wrap=False)  # -> List, Index
join_curves = JoinCurves(Curves=sub_list.List, Preserve=False)
dispatch = Dispatch(List=join_curves, DispatchPattern=[True, False])  # -> ListA, ListB
flip_curve = FlipCurve(Curve=dispatch.ListB)  # -> Curve, Flag
loft = Loft(
    Curves=[dispatch.ListA, flip_curve.Curve],
    Options={Adjust=False, Closed=False, LoftEnds=0, LoftSimp=0, LoftType=3, Rebuild=10, Refit=0.01})
tile_surfaces = Surface(loft)
tile_surfaces_2 = ClusterOutput(tile_surfaces)
